vi "main.gviweb"   [LabVIEW NXG 4.0.0]
panel controls:
  "error in": error
  "Power Button": bool
panel indicators:
  "Card_1": T1
  "Card_2": T1
  "Card_3": T1
  "Card_4": T1
  "Card_5": T1
  "Card_6": T1
  "Card_7": T1
  "Card_8": T1
  "dockBar": string
  "URL Image": string
  "freeNum": string
  "URL Image_2": string
  "busyNum": string
  "URL Image_3": string
  "awayNum": string
  "URL Image_4": string
  "Talks": string
  "errror out": error
  "Time": string
  "Date": string
types:
  T1 = cluster{"AE-Photo": string, "Radial Progress Bar": f64, "CurrentStatePeriod": string, "FullName": string, "ColorCircle": string, "CardBackground": string}
uses:
  SubVIs::createCardTag.gvi
  SubVIs::readCardTag.gvi
  NI::Skyline::TagHTTP::Close Tag (Multiple).gvi
  SubVIs::createBasicTag.gvi
  SubVIs::readBasicTag.gvi
  SubVIs::DateAndTime.gvi
diagram:
  w1 = $"error in"
  while {
    Build Array(reference to "Card_1", reference to "Card_2", reference to "Card_3", reference to "Card_4", reference to "Card_5", reference to "Card_6", reference to "Card_7", reference to "Card_8") -> w2
    for (N = 8) (iteration -> i1) {
      w3 = each element of w2
      Increment(x=i1) -> w4
      call "createCardTag.gvi"(server url="http://sh-ae-board", username="admin", password="Dashboard", error in=w1, Card No=w4) -> (tags=w5, error out=w6)
      call "readCardTag.gvi"(tags in=w5, error in=w6) -> (tags out=w7, state cluster=w8, errror out=w9)
      Property Node(instance in=w8) -> ("Element 1"=w10, "Element 2"=w11, "Element 3"=w12, "Element 4"=w13, "Element 5"=w14, "Element 6"=w15)
      Build Cluster(w15, w12, w14, w11, w13, "Resources/CardBG.png") -> w16
      Property Node(instance in=w3, "Value"=w16, "Visible"=w10)
      call "Close Tag (Multiple).gvi"(tags=w7, error in=w9)
    }
    call "createBasicTag.gvi"(server url="http://sh-ae-board", username="admin", password="Dashboard", error in=w1) -> (tags=w17, error out=w18)
    call "readBasicTag.gvi"(tags in=w17, error in=w18) -> (Output=w19, errror out=w20)
    Array To Cluster[NumberOfClusterElements=6](array=w19) -> (cluster=w21)
    Property Node(instance in=w21) -> ("Element 1"=w22, "Element 2"=w23, "Element 3"=w24, "Element 4"=w25)
    $freeNum <- w22
    $awayNum <- w24
    $Talks <- w25
    $busyNum <- w23
    stop if $"Power Button"
  }
  while {
    call "DateAndTime.gvi"(Error In=w1) -> (Date=w26, Time=w27, Error Out=w28)
    $Date <- w26
    $Time <- w27
    Wait(time to wait=1000)
    stop if $"Power Button"
  }
  Merge Errors(w20, w28) -> (error out=w29)
  $"errror out" <- w29
  Build Cluster("Photos/Sha%20Wang.jpg", 33, "09:55", "Yi Xu", "Resources/greenCircle.png", "Resources/CardBG.png") -> w30
  $Card_1 <- w30
  $Card_2 <- w30
  $Card_3 <- w30
  $Card_4 <- w30
  $Card_5 <- w30
  $Card_6 <- w30
  $Card_7 <- w30
  $Card_8 <- w30
