vi "tag.gviweb"   [LabVIEW NXG 4.0.0]
panel controls:
  "error in": error
panel indicators:
  "error out": error
  "loop iteration": i32
  "value": f64
uses:
  NI::Skyline::Configuration::Open Configuration.gvi
  NI::Skyline::TagHTTP::Open Tag.gvi
  NI::Skyline::TagHTTP::Read Tag (DBL).gvi
  NI::Skyline::Configuration::Close Configuration.gvi
diagram:
  call "Open Configuration.gvi"(server url="http://sh-ae-board", username="admin", password="Dashboard", error in=$"error in") -> (configuration=w1, error out=w2)
  call "Open Tag.gvi"(path="SystemLink.Dashboard.test", data type="I32", error in=w2, configuration=w1) -> (tag=w3, error out=w4)
  while (iteration -> i1) {
    Wait(time to wait=1000)
    call "Read Tag (DBL).gvi"(tag in=w3, error in=w4) -> (value=w5, error out=w6)
    $value <- w5
    $"loop iteration" <- i1
    stop if FALSE
  }
  call "Close Configuration.gvi"(configuration=w1, error in=w6) -> (error out=w7)
  $"error out" <- w7
