vi "createCardTag.gvi"   [LabVIEW NXG 4.0.0]
inputs:
  "error in": error
  "Card No": i32 = 8
  "server url": string
  "username": string
  "password": string
outputs:
  "error out": error
  "tags": "Tag.gtype"[]
types:
  "DataType.gtype" = enum{"Double", "I32", "String", "Boolean", "U64", "Timestamp"}
  "Client Handle.gtype" = u32
  "Configuration.gtype" = cluster{"Server URL": string, "Session": "Client Handle.gtype"}
  "Tag.gtype" = cluster{"Path": string, "Datatype": "DataType.gtype", "Configuration": "Configuration.gtype"}
uses:
  NI::Skyline::Configuration::Open Configuration.gvi
  NI::Skyline::TagHTTP::Open Tag.gvi
diagram:
  w1 = ["SystemLink.Dashboard.Card.Visible.Card", "SystemLink.Dashboard.Card.FullName.Card", "SystemLink.Dashboard.Card.ProgressBar.Card", "SystemLink.Dashboard.Card.StateColor.Card", "SystemLink.Dashboard.Card.TimeInState.Card", "SystemLink.Dashboard.Card.PhotoPath.Card", "", "", "", "", "", "", "", "", "", "", "", "", "", ""]
  s1 = string[] []  # shift register
  for (N = 6) {
    w2 = each element of w1
    Number To Decimal String(number=$"Card No") -> (decimal integer string=w3)
    Concatenate Strings(w2, w3) -> w4
    Insert Into Array(inArray=s1, new=w4) -> w5
    next s1 = w5
  }
  call "Open Configuration.gvi"(server url=$"server url", username=$username, password=$password, error in=$"error in") -> (configuration=w6, error out=w7)
  Build Array("Boolean", "String", "I32", "String", "String", "String") -> w8
  for {
    w9 = each element of s1
    w10 = each element of w8
    call "Open Tag.gvi"(path=w9, data type=w10, error in=w7, configuration=w6) -> (tag=w12, error out=w13)
    append w12 to w11
    stop if w13
  }
  $tags <- w11
  $"error out" <- w13
