vi "writeBasicTag.gvi"   [LabVIEW NXG 4.0.0]
inputs:
  "error in": error
  "tags in": "Tag.gtype"[]
  "Array": string[]
outputs:
  "errror out": error
  "tags out": "Tag.gtype"[]
types:
  "DataType.gtype" = enum{"Double", "I32", "String", "Boolean", "U64", "Timestamp"}
  "Client Handle.gtype" = u32
  "Configuration.gtype" = cluster{"Server URL": string, "Session": "Client Handle.gtype"}
  "Tag.gtype" = cluster{"Path": string, "Datatype": "DataType.gtype", "Configuration": "Configuration.gtype"}
uses:
  NI::Skyline::TagHTTP::Write Tag (String).gvi
diagram:
  Array To Cluster[NumberOfClusterElements=6](array=$Array) -> (cluster=w1)
  Property Node(instance in=w1) -> ("Element 0"=w2, "Element 1"=w3, "Element 2"=w4, "Element 3"=w5, "Element 4"=w6, "Element 5"=w7)
  case ($"error in") {
    frame Error, Default {
      w8 = $"error in"
      w9 = $"tags in"
    }
    frame No Error {
      Array Index(array=$"tags in") -> (out0[_]=w10, out1[_]=w11, out2[_]=w12, out3[_]=w13, out4[_]=w14, out5[_]=w15)
      call "Write Tag (String).gvi"(tag in=w10, value=w2, error in=$"error in") -> (error out=w16)
      call "Write Tag (String).gvi"(tag in=w11, value=w3, error in=$"error in") -> (error out=w17)
      call "Write Tag (String).gvi"(tag in=w12, value=w4, error in=$"error in") -> (error out=w18)
      call "Write Tag (String).gvi"(tag in=w13, value=w5, error in=$"error in") -> (error out=w19)
      call "Write Tag (String).gvi"(tag in=w14, value=w6, error in=$"error in") -> (error out=w20)
      call "Write Tag (String).gvi"(tag in=w15, value=w7, error in=$"error in") -> (error out=w21)
      Merge Errors(w16, w17, w18, w19, w20, w21) -> (error out=w8)
      w9 = $"tags in"
    }
  }
  $"tags out" <- w9
  $"errror out" <- w8
