vi "main.gvi"   [LabVIEW NXG 4.0.0]
panel controls:
  "error in": error
  "stop": bool
panel indicators:
  "error out": error
  "loop iteration": i32
  "loop iteration_2": i32
types:
  T1 = cluster{"Element 0": string, "Element 1": string, "Element 2": string, "Element 3": string, "Element 4": string, "Element 5": string, "Element 6": string}
uses:
  desktop::python.gvi
  desktop::text.gvi
  SubVIs::createBasicTag.gvi
  SubVIs::writeBasicTag.gvi
  NI::Skyline::TagHTTP::Close Tag (Multiple).gvi
  SubVIs::createCardTag.gvi
  SubVIs::time1.gvi
  SubVIs::name2pic.gvi
  SubVIs::writeCardTag.gvi
diagram:
  w1 = $"error in"
  while (iteration -> i1) {
    $"loop iteration" <- i1
    call "python.gvi"(error in=w1) -> (error out=w2)
    call "text.gvi"(error in=w2) -> (basicState Array=w3, aeState Array=w4, error out=w5)
    Array Size(array=w4) -> (size(s)=w6)
    Array To Cluster[NumberOfClusterElements=9](array=w6) -> (cluster=w7)
    Property Node(instance in=w7) -> ("Element 0"=w8)
    s1 = T1[] []  # shift register
    s2 = T1[] []  # shift register
    s3 = T1[] []  # shift register
    for (N = w8) {
      w9 = each element of w4
      Array To Cluster[NumberOfClusterElements=7](array=w9) -> (cluster=w10)
      Property Node(instance in=w10) -> ("Element 4"=w11)
      case (w11) {
        frame "False", Default {
          w12 = s1
          w13 = s2
          w14 = s3
        }
        frame "Free" {
          Insert Into Array(inArray=s1, new=w10) -> w12
          w13 = s2
          w14 = s3
        }
        frame "Busy" {
          Insert Into Array(inArray=s3, new=w10) -> w14
          w12 = s1
          w13 = s2
        }
        frame "Away" {
          Insert Into Array(inArray=s2, new=w10) -> w13
          w12 = s1
          w14 = s3
        }
      }
      next s1 = w12
      next s2 = w13
      next s3 = w14
    }
    call "createBasicTag.gvi"(server url="http://sh-ae-board", username="admin", password="Dashboard", error in=w5) -> (tags=w15, error out=w16)
    call "writeBasicTag.gvi"(tags in=w15, Array=w3, error in=w16) -> (tags out=w17, errror out=w18)
    call "Close Tag (Multiple).gvi"(tags=w17, error in=w18) -> (error out=w19)
    Array To Cluster[NumberOfClusterElements=6](array=w3) -> (cluster=w20)
    Property Node(instance in=w20) -> ("Element 1"=w21, "Element 2"=w22, "Element 3"=w23)
    Decimal String To Number(string=w21) -> (number=w24)
    Decimal String To Number(string=w22) -> (number=w25)
    for (N = w25) (iteration -> i2) {
      w26 = each element of s3
      Property Node(instance in=w26) -> ("Element 0"=w27, "Element 5"=w28, "Element 6"=w29)
      Increment(x=i2) -> w30
      Add(w24, w30) -> w31
      call "createCardTag.gvi"(server url="http://sh-ae-board", username="admin", password="Dashboard", error in=w19, Card No=w31) -> (tags=w32)
      Decimal String To Number(string=w29) -> (number=w33)
      call "time1.gvi"(字符串=w28) -> (连接的字符串=w34)
      call "name2pic.gvi"(name=w27, error in=w19) -> (PhotoPath=w35, error out=w36)
      call "writeCardTag.gvi"(Visible=TRUE, FullName=w27, ProgressBar=w33, StateColor="Resources/redCircle.png", TimeInState=w34, PhotoPath=w35, error in=w36, tags in=w32) -> (errror out=w37, tags out=w38)
      call "Close Tag (Multiple).gvi"(tags=w38, error in=w37) -> (error out=w39)
    }
    Decimal String To Number(string=w23) -> (number=w40)
    for (N = w40) (iteration -> i3) {
      w41 = each element of s2
      Property Node(instance in=w41) -> ("Element 0"=w42, "Element 5"=w43, "Element 6"=w44)
      Increment(x=i3) -> w45
      Add(w24, w45) -> w46
      Add(w25, w46) -> w47
      call "createCardTag.gvi"(server url="http://sh-ae-board", username="admin", password="Dashboard", error in=w19, Card No=w47) -> (tags=w48)
      Decimal String To Number(string=w44) -> (number=w49)
      call "time1.gvi"(字符串=w43) -> (连接的字符串=w50)
      call "name2pic.gvi"(name=w42, error in=w19) -> (PhotoPath=w51, error out=w52)
      call "writeCardTag.gvi"(Visible=TRUE, FullName=w42, ProgressBar=w49, StateColor="Resources/yellowCircle.png", TimeInState=w50, PhotoPath=w51, error in=w52, tags in=w48) -> (errror out=w53, tags out=w54)
      call "Close Tag (Multiple).gvi"(tags=w54, error in=w53) -> (error out=w55)
    }
    for (N = w24) (iteration -> i4) {
      w56 = each element of s1
      Property Node(instance in=w56) -> ("Element 0"=w57, "Element 5"=w58, "Element 6"=w59)
      Increment(x=i4) -> w60
      call "createCardTag.gvi"(server url="http://sh-ae-board", username="admin", password="Dashboard", error in=w19, Card No=w60) -> (tags=w61)
      Decimal String To Number(string=w59) -> (number=w62)
      call "time1.gvi"(字符串=w58) -> (连接的字符串=w63)
      call "name2pic.gvi"(name=w57, error in=w19) -> (PhotoPath=w64, error out=w65)
      call "writeCardTag.gvi"(Visible=TRUE, FullName=w57, ProgressBar=w62, StateColor="Resources/greenCircle.png", TimeInState=w63, PhotoPath=w64, error in=w65, tags in=w61) -> (errror out=w66, tags out=w67)
      call "Close Tag (Multiple).gvi"(tags=w67, error in=w66) -> (error out=w68)
    }
    Merge Errors(w39, w55, w68) -> (error out=w69)
    stop if $stop
  }
  $"error out" <- w69
  while (iteration -> i5) (after w1) {
    Wait(time to wait=1000)
    $"loop iteration_2" <- i5
    stop if $stop
  }
